# Grasshopper definition circle stacking 1.gh (Grasshopper 1.0.4)
# plug-ins: EleFront

bake = Button()
dropout_number = Slider(6, range=0..40)
rib_seed = Slider(2, range=0..20)
dropout_probability = Slider(19, range=0..100)
dropout_seed = Slider(7, range=0..20)
rib_count = Slider(24, range=0..40)
crv = Curve(<curve referenced from the Rhino model>)
random = Random(Range=Domain(0, 100), Number=dropout_number, Seed=dropout_seed)
random_2 = Random(Range=Domain(1, 3), Number=rib_count, Seed=rib_seed)
concat = Concatenate(
    FragmentA="Rib Count: ",
    FragmentB=rib_count,
    FragmentC=", Rib Seed: ",
    FragmentD=rib_seed,
    FragmentE=", Dropout Number: ",
    FragmentF=dropout_number,
    FragmentG=", Dropout Seed: ",
    FragmentH=dropout_seed,
    FragmentI=", Dropout Probability: ",
    FragmentJ=dropout_probability)
smaller = SmallerThan(FirstNumber=random, SecondNumber=dropout_probability)  # -> SmallerThan, OrEqualTo
int = Integer(random_2)
division = Division(A=int, B=8)

series = Series(Start=0, Step=1, Count=rib_count)
rev = ReverseList(List=series)
shift = ShiftList(List=division, Shift=graft(rev), Wrap=False)
panel = Panel("Cn = SUM[0->n](2*Ri) + Rn")
ma = MassAddition(Input=shift)  # -> Result, PartialResults
multiplication = Multiplication(A=2, B=ma.Result)
flatten = FlattenTree(Tree=multiplication, Path="{0}")
ins = InsertItems(List=flatten, Item=0, Indices=0, Wrap=True)

rev_2 = ReverseList(List=division)
addition = Addition(A=rev_2, B=ins)
panel_2 = Panel(rev_2)
panel_3 = Panel(ins)
sift = SiftPattern(List=rev_2, SiftPattern=smaller.OrEqualTo)  # -> Output0, Output1
panel_4 = Panel(sift.Output0)
nullrep = ReplaceNulls(Items=sift.Output0, Replacements=0)  # -> Items, Count
xz = XZPlane(Origin=Point(0, 0, 0))
eval = EvaluateLength(Curve=crv, Length=addition, Normalized=False)  # -> Point, Tangent, Parameter
pt = Point(eval.Point)
circle = CircleCNR(Center=eval.Point, Normal=xz, Radius=nullrep.Items)
material = CreateMaterial(Diffuse=RGB(184, 255, 248), Specular=RGB(255, 255, 255), Emission=RGB(0, 0, 0), Transparency=0, Shine=0)
revsrf = Revolution(Curve=crv, Axis=Line((0, 0, 0), (0, 0, 6.75)), Domain=Domain(0, 6.283185307))
revsrf_2 = Revolution(Curve=circle, Axis=Line((0, 0, 0), (0, 0, 6.75)), Domain=Domain(0, 6.283185307))
bake_2 = BakeObjects(Geometry=[circle, pt, revsrf_2], BakeName=concat, Bake=bake)
cap = CapHoles(Brep=revsrf)
preview = CustomPreview(Geometry=[cap, revsrf_2], Material=material)
multiplication_2 = Multiplication(A=nullrep.Items, B=8)
sift_2 = SiftPattern(List=eval.Point, SiftPattern=multiplication_2)  # -> Output0, Output1, Output2, Output3
pdecon = Deconstruct(Point=sift_2.Output2)  # -> XComponent, YComponent, ZComponent
pdecon_2 = Deconstruct(Point=sift_2.Output1)  # -> XComponent, YComponent, ZComponent
pdecon_3 = Deconstruct(Point=sift_2.Output3)  # -> XComponent, YComponent, ZComponent
pt_2 = ConstructPoint(XCoordinate=0, YCoordinate=0, ZCoordinate=pdecon.ZComponent)
pt_3 = ConstructPoint(XCoordinate=0, YCoordinate=0, ZCoordinate=pdecon_2.ZComponent)
pt_4 = ConstructPoint(XCoordinate=0, YCoordinate=0, ZCoordinate=pdecon_3.ZComponent)
neg = Negative(Value=pdecon.XComponent)
neg_2 = Negative(Value=pdecon_2.XComponent)
neg_3 = Negative(Value=pdecon_3.XComponent)
_3_8_paths = CircleCNR(Center=pt_2, Normal=Vector(0, 0, 1), Radius=neg)
_1_4_paths = CircleCNR(Center=pt_3, Normal=Vector(0, 0, 1), Radius=neg_2)
_1_2_paths = CircleCNR(Center=pt_4, Normal=Vector(0, 0, 1), Radius=neg_3)
yz = YZPlane(Origin=Point(0, 0, 0))
rotate = Rotate(Geometry=_1_4_paths, Angle=4.71238898, Plane=yz)  # -> Geometry, Transform
rotate_2 = Rotate(Geometry=_3_8_paths, Angle=4.71238898, Plane=yz)  # -> Geometry, Transform
rotate_3 = Rotate(Geometry=_1_2_paths, Angle=4.71238898, Plane=yz)  # -> Geometry, Transform
