# Grasshopper definition flower cup bottom.gh (Grasshopper 1.0.4)

crv = Curve(<curve referenced from the Rhino model>)
polar_array_count = Slider(8, range=0..31)
crv_2 = Curve(<curve referenced from the Rhino model>)
pt = Point(<point referenced from the Rhino model>)
crv_3 = Curve(<curve referenced from the Rhino model>)
crv_4 = Curve(<curve referenced from the Rhino model>)
divide = DivideCurve(Curve=crv_2, Count=Slider(8, range=0..31), Kinks=False)  # -> Points, Tangents, Parameters
crv_cp = CurveClosestPoint(Point=divide.Points, Curve=crv_3)  # -> Point, Parameter, Distance
crv_cp_2 = CurveClosestPoint(Point=divide.Points, Curve=crv_4)  # -> Point, Parameter, Distance
vec2pt = Vector2Pt(PointA=pt, PointB=divide.Points, Unitize=True)  # -> Vector, Length
dist = Distance(PointA=divide.Points, PointB=crv_cp.Point)
multiplication = Multiplication(A=vec2pt.Vector, B=dist)
addition = Addition(A=divide.Points, B=multiplication)
arc = Arc3Pt(PointA=crv_cp.Point, PointB=addition, PointC=crv_cp_2.Point)  # -> Arc, Plane, Radius
arrpolar = PolarArray(Geometry=arc.Arc, Plane=pt, Count=polar_array_count, Angle=6.283185307)  # -> Geometry, Transform
trim = TrimWithRegion(Curve=arrpolar.Geometry, Region=crv)  # -> Inside, Outside
crv_5 = Curve(trim.Inside)
offset = Offset(Curve=crv_5, Distance=0.0625, Plane=PlaneXY(0, 0, 0), Corners=1)  # disabled
offset_2 = Offset(Curve=crv_5, Distance=-0.0625, Plane=PlaneXY(0, 0, 0), Corners=1)  # disabled
crv_6 = Curve(offset)
crv_7 = Curve(offset_2)
