# Grasshopper definition grass.gh (Grasshopper 1.0.4)

wiggle = Slider(-2.002, range=-2.002..0.001)
wiggle_2 = Slider(1.085, range=-2..5.001)
bend = Slider(-0.595, range=-1..1)
height = Slider(7.403, range=1..10.001)
number_slider = Slider(129, range=0..132)
reach = Slider(1.503, range=1..4.001)
neg = Negative(Value=bend)
sqr = Square(Value=Slider(0, range=0..101))
dom = ConstructDomain(DomainStart=wiggle, DomainEnd=wiggle_2)
dom_2 = ConstructDomain(DomainStart=1, DomainEnd=reach)
sqr_2 = Square(Value=sqr)
dom_3 = ConstructDomain(DomainStart=neg, DomainEnd=bend)
dom_4 = ConstructDomain(DomainStart=1, DomainEnd=height)
root = Random(Range=Domain(0, 20), Number=number_slider, Seed=sqr)
bend_2 = Random(Range=dom_3, Number=number_slider, Seed=sqr_2)
wiggle_3 = Random(Range=dom, Number=number_slider, Seed=75)
height_2 = Random(Range=dom_4, Number=number_slider, Seed=29837)
reach_2 = Random(Range=dom_2, Number=number_slider, Seed=8726)
pt = ConstructPoint(XCoordinate=root, YCoordinate=0, ZCoordinate=0)
vec = VectorXYZ(XComponent=bend_2, YComponent=height_2, ZComponent=0)  # -> Vector, Length
move = Move(Geometry=pt, Motion=vec.Vector)  # -> graft(Geometry), Transform
multiplication = Multiplication(A=height_2, B=reach_2)
multiplication_2 = Multiplication(A=bend_2, B=wiggle_3)
pt_2 = Point(graft(pt))
vec_2 = VectorXYZ(XComponent=multiplication_2, YComponent=multiplication, ZComponent=0)  # -> Vector, Length
move_2 = Move(Geometry=pt, Motion=vec_2.Vector)  # -> graft(Geometry), Transform
panel = Panel(pt_2)
pt_3 = Point([pt_2, move.Geometry, move_2.Geometry])
intcrv_t = InterpolateT(Vertices=pt_3, TangentStart=Vector(0, 0, 0), TangentEnd=Vector(0, 0, 0), KnotStyle=1)  # -> Curve, Length, Domain
