# Grasshopper definition 1. Create Mold Blank.gh (Grasshopper 1.0.4)
# plug-ins: EleFront

panel = Panel("Create Mold Blank")
bake_now = Button()
pipeline = GeometryPipeline(
    GroupByLayer=False,
    GroupByType=False,
    IncludeHidden=True,
    IncludeLocked=True,
    LayerFilter="Source::Form",
    NameFilter="*",
    SublayerFiltering=True,
    TypeFilter=1073741848)
pipeline_2 = GeometryPipeline(
    GroupByLayer=False,
    GroupByType=False,
    IncludeHidden=True,
    IncludeLocked=True,
    LayerFilter="Source::Blank Inverse",
    NameFilter="*",
    SublayerFiltering=True,
    TypeFilter=1073741848)
pipeline_3 = GeometryPipeline(
    GroupByLayer=False,
    GroupByType=False,
    IncludeHidden=True,
    IncludeLocked=True,
    LayerFilter="Source::Blank",
    NameFilter="*",
    SublayerFiltering=True,
    TypeFilter=1)
pipeline_4 = GeometryPipeline(
    GroupByLayer=False,
    GroupByType=False,
    IncludeHidden=True,
    IncludeLocked=True,
    LayerFilter="Source::Blank",
    NameFilter="*",
    SublayerFiltering=True,
    TypeFilter=1073741848)
docstr = CSharpScript(Key="Bit Diameter")  # -> out, A; inputs Key: String
# ---------- docstr: C# ----------
    doc = Rhino.RhinoDoc.ActiveDoc;
    for (int i = 0; i < doc.Strings.Count; i++)
    {
      if (String.Equals(doc.Strings.GetKey(i), Key as string, StringComparison.OrdinalIgnoreCase))
        A = doc.Strings.GetValue(i);
    }
# ---------- end docstr ----------
range = Range(Domain=Domain(0, 270), Steps=3)
panel_2 = Panel(docstr.A)
bit_radius = Division(A=panel_2, B=2)
pt = Point(graft(pipeline_3))
xz = XZPlane(Origin=pt)
rotate = Rotate(Geometry=pipeline, Angle=degrees(range), Plane=xz)  # -> Geometry, Transform
neg = Negative(Value=panel_2)
neg_2 = Negative(Value=bit_radius)
vec = VectorXYZ(XComponent=0, YComponent=0, ZComponent=bit_radius)  # -> Vector, Length
shifted_blank_in = Move(Geometry=pipeline_2, Motion=vec.Vector)  # -> Geometry, Transform
shifted_blank = Move(Geometry=pipeline_4, Motion=vec.Vector)  # -> Geometry, Transform
vec_2 = Vector(Vector(0, 8, 0))
range_2 = Range(Domain=Domain(0, 18), Steps=3)
X = UnitX(Factor=1)
multiplication = Multiplication(A=vec_2, B=2)
multiplication_2 = Multiplication(A=range_2, B=X)
addition = Addition(A=multiplication_2, B=vec_2)
addition_2 = Addition(A=multiplication_2, B=multiplication)

texture_bit_center = Offset(Surface=rotate.Geometry, Distance=neg_2, Retrim=True)
finish_surfaces = TrimSolid(Shape=texture_bit_center, Cutters=shifted_blank_in.Geometry)  # -> flatten(Result)
move = Move(Geometry=[finish_surfaces, pt], Motion=addition_2)  # -> Geometry, Transform
layer = DefineLayer(Name="Mold::Finish Surfaces")
attributes = DefineObjectAttributes(UserKeys=["Object", "Object", "Object", "Object"], UserValues=["1", "2", "3", "4"], Layer=layer)
bake = BakeObjects(Geometry=move.Geometry, Attributes=attributes, BakeName=layer, Bake=bake_now)

roughing_bit_center = Offset(Surface=rotate.Geometry, Distance=neg, Retrim=True)
layer_2 = DefineLayer(Name="Mold::Roughing Volume")
attributes_2 = DefineObjectAttributes(Layer=layer_2)  # -> graft(Attributes)

cap = CapHoles(Brep=roughing_bit_center)

roughing_surfaces = TrimSolid(Shape=roughing_bit_center, Cutters=shifted_blank_in.Geometry)  # -> flatten(Result)
move_2 = Move(Geometry=[roughing_surfaces, pt], Motion=addition)  # -> Geometry, Transform
layer_3 = DefineLayer(Name="Mold::Roughing Surfaces")
attributes_3 = DefineObjectAttributes(Layer=layer_3)
bake_2 = BakeObjects(Geometry=move_2.Geometry, Attributes=attributes_3, BakeName=layer_3, Bake=bake_now)

roughing_volumes = SolidIntersection(BrepsA=cap, BrepsB=shifted_blank.Geometry)
move_3 = Move(Geometry=[roughing_volumes, pipeline_3], Motion=multiplication_2)  # -> Geometry, Transform
bake_3 = BakeObjects(Geometry=graft(move_3.Geometry), Attributes=attributes_2, BakeName=layer_2, Bake=bake_now)
