# Grasshopper definition 2. Roughing.gh (Grasshopper 1.0.4)
# plug-ins: EleFront

panel = Panel("Roughing Pass 1")
bake_now = Button()
horizontal_spacing = Slider(0.1, range=0..0.5)
vertical_spacing = Slider(0.33, range=0..0.55)
pipeline = GeometryPipeline(
    GroupByLayer=False,
    GroupByType=False,
    IncludeHidden=True,
    IncludeLocked=True,
    LayerFilter="Mold::Roughing Volume",
    NameFilter="*",
    SublayerFiltering=True,
    TypeFilter=1073741848)
docstr = CSharpScript(Key="PassingHeight")  # -> out, A; inputs Key: String
# ---------- docstr: C# ----------
    doc = Rhino.RhinoDoc.ActiveDoc;
    for (int i = 0; i < doc.Strings.Count; i++)
    {
      if (String.Equals(doc.Strings.GetKey(i), Key as string, StringComparison.OrdinalIgnoreCase))
        A = doc.Strings.GetValue(i);
    }
# ---------- end docstr ----------
docstr_2 = CSharpScript(Key="Bit Diameter")  # -> out, A; inputs Key: String; same code as docstr
panel_2 = Panel(docstr.A)
panel_3 = Panel(docstr_2.A)
getua = GetUserAttributes(Geometry=pipeline)  # -> Keys, Values, BakeName
division = Division(A=panel_3, B=2)
brep = Brep(graft(pipeline))
panel_4 = Panel(getua.Keys)

# ---- group: Horizontal Slices
bbox = BoundingBox(Content=brep, Plane=PlaneXY(0, 0, 0))  # -> Box, Box_2
box_corners = BoxCorners(Box=bbox.Box)  # -> CornerA, CornerB, CornerC, CornerD, CornerE, CornerF, CornerG, CornerH
pl_3pt = Plane3Pt(PointA=box_corners.CornerA, PointB=box_corners.CornerB, PointC=box_corners.CornerC)
ln = Line(StartPoint=box_corners.CornerA, EndPoint=box_corners.CornerE)
len = Length(Curve=ln)
division_2 = Division(A=len, B=vertical_spacing)
planesrf = PlaneSurface(Plane=pl_3pt, XSize=Domain(-10, 10), YSize=Domain(-10, 10))

# ----
addition = Addition(A=division_2, B=1)

# ---- group: Horizontal Slices (continued)
divide = DivideCurve(Curve=ln, Count=addition, Kinks=False)  # -> Points, Tangents, Parameters
vec2pt = Vector2Pt(PointA=divide.Points, PointB=box_corners.CornerE, Unitize=False)  # -> Vector, Length
move = Move(Geometry=planesrf, Motion=vec2pt.Vector)  # -> Geometry, Transform
bbx = BrepBrep(BrepA=move.Geometry, BrepB=brep)  # -> Curves, Points
boundary = BoundarySurfaces(Edges=bbx.Curves)

# ---- group: Vertical Slices
bbox_2 = BoundingBox(Content=boundary, Plane=PlaneXY(0, 0, 0))  # -> Box, Box_2
box_corners_2 = BoxCorners(Box=bbox_2.Box)  # -> CornerA, CornerB, CornerC, CornerD, CornerE, CornerF, CornerG, CornerH
ln_2 = Line(StartPoint=box_corners_2.CornerA, EndPoint=box_corners_2.CornerB)
len_2 = Length(Curve=ln_2)
division_3 = Division(A=len_2, B=horizontal_spacing)
addition_2 = Addition(A=division_3, B=1)
divide_2 = DivideCurve(Curve=ln_2, Count=addition_2, Kinks=False)  # -> Points, Tangents, Parameters
yz = YZPlane(Origin=divide_2.Points)
planesrf_2 = PlaneSurface(Plane=yz, XSize=Domain(-20, 20), YSize=Domain(-10, 10))

# ---- group: Polyline for each layer
bbx_2 = BrepBrep(BrepA=graft(boundary), BrepB=planesrf_2)  # -> Curves, Points
trim = TrimTree(Tree=bbx_2.Curves, Depth=1)
sift = SiftPattern(List=trim, SiftPattern=[0, 1])  # -> Output0, Output1
flip = FlipCurve(Curve=sift.Output1)  # -> Curve, Flag
combine = CombineData(Input0=sift.Output0, Input1=flip.Curve)  # -> Result, Index
explode = Explode(Curve=combine.Result, Recursive=True)  # -> Segments, Vertices
trim_2 = TrimTree(Tree=explode.Vertices, Depth=1)
clean = CleanTree(RemoveNulls=True, RemoveInvalid=True, RemoveEmpty=True, Tree=trim_2)
Z = UnitZ(Factor=1)
multiplication = Multiplication(A="0", B=Z)
neg = Negative(Value=multiplication)
move_2 = Move(Geometry=clean, Motion=neg)  # -> Geometry, Transform

# ---- group: Exit Path
lng = ListLength(List=clean)
subtraction = Subtraction(A=lng, B=1)
item = ListItem(List=clean, Index=subtraction, Wrap=True)
pdecon = Deconstruct(Point=item)  # -> XComponent, YComponent, ZComponent
pt = ConstructPoint(XCoordinate=pdecon.XComponent, YCoordinate=pdecon.YComponent, ZCoordinate=panel_2)

# ---- group: Entry Path
item_2 = ListItem(List=clean, Index=0, Wrap=True)
pdecon_2 = Deconstruct(Point=item_2)  # -> XComponent, YComponent, ZComponent
pt_2 = ConstructPoint(XCoordinate=pdecon_2.XComponent, YCoordinate=pdecon_2.YComponent, ZCoordinate=panel_2)

# ----
pline = PolyLine(Vertices=clean, Closed=False)

# ---- group: Polyline for each layer (continued)
pt_3 = Point([pt_2, move_2.Geometry, pt])
pline_2 = PolyLine(Vertices=pt_3, Closed=False)

# ---- group: Connect Layers
simplify = SimplifyTree(Tree=pline_2, Front=False)
trim_3 = TrimTree(Tree=simplify, Depth=1)
explode_2 = Explode(Curve=trim_3, Recursive=True)  # -> Segments, Vertices
trim_4 = TrimTree(Tree=explode_2.Vertices, Depth=1)
pline_3 = PolyLine(Vertices=trim_4, Closed=False)

# ----
panel_5 = Panel(simplify)
graft = GraftTree(Tree=simplify, IncludeEmptyLists=True, IncludeNullItems=True)
c_script = CSharpScript(BakeNow=bake_now, Geometry=graft, Layer="Roughing::Pass 1", CacheName="Toolpaths")  # -> out, A; inputs BakeNow: Boolean, Geometry: tree, Layer: String, CacheName: String
# ---------- c_script: C# ----------
    if (!BakeNow)
      return;
    
    var doc = Rhino.RhinoDoc.ActiveDoc;
    var result = new System.Text.StringBuilder();
    var layerIndex = doc.Layers.FindByFullPath(Layer, 0);
    var key = string.Format("Cache({0})", CacheName);

    // Delete existing cache data
    var existing = doc.Objects.FindByUserString(key, "*", false);
    foreach(RhinoObject obj in existing)
    {
      if (obj.Attributes.LayerIndex == layerIndex)
      {
        doc.Objects.Delete(obj, true);
      }
    }



    // Save geometry to model
    for (int i = 0; i < Geometry.Branches.Count; i++)
    {
      var path = Geometry.Paths[i];
      for (int g = 0; g < Geometry.Branches[i].Count; g++)
      {
        var geo = Geometry.Branches[i][g];
        var attr = new Rhino.DocObjects.ObjectAttributes();
        var cacheValue = string.Format("{0}({1})", path, g);
        attr.SetUserString(key, cacheValue);
        attr.LayerIndex = layerIndex;
        result.Append(cacheValue).Append("\r\n");
        result.Append(geo.GetType()).Append("\r\n");
        doc.Objects.Add((Rhino.Geometry.GeometryBase) geo, attr);
      }
    }
    A = result;
# ---------- end c_script ----------
panel_6 = Panel(graft)
c_script_2 = CSharpScript(BakeNow=Button(), Geometry=graft, CacheName="Roughing 1")  # -> out, A; inputs BakeNow: Boolean, Geometry: tree, Layer: String, CacheName: String
# ---------- c_script_2: C# ----------
    if (!BakeNow)
      return;

    var doc = Rhino.RhinoDoc.ActiveDoc;
    var result = new System.Text.StringBuilder();
    int layerIndex = 0;
    if (Layer == null)
      layerIndex = doc.Layers.CurrentLayerIndex;
    else
      layerIndex = doc.Layers.FindByFullPath(Layer, 0);
    var key = string.Format("Cache({0})", CacheName);

    // Delete existing cache data
    var existing = doc.Objects.FindByUserString(key, "*", false);
    foreach(RhinoObject obj in existing)
    {
      if (obj.Attributes.LayerIndex == layerIndex)
      {
        doc.Objects.Delete(obj, true);
      }
    }



    // Save geometry to model
    for (int i = 0; i < Geometry.Branches.Count; i++)
    {
      var path = Geometry.Paths[i];
      for (int g = 0; g < Geometry.Branches[i].Count; g++)
      {
        var geo = Geometry.Branches[i][g];
        var attr = new Rhino.DocObjects.ObjectAttributes();
        var cacheValue = string.Format("{0}({1})", path, g);
        attr.SetUserString(key, cacheValue);
        attr.LayerIndex = layerIndex;
        result.Append(cacheValue).Append("\r\n");
        result.Append(geo.GetType()).Append("\r\n");
        if (geo is Rhino.Geometry.Line)
          doc.Objects.AddLine((Rhino.Geometry.Line) geo, attr);
        else
          doc.Objects.Add((Rhino.Geometry.GeometryBase) geo, attr);
      }
    }
    A = result;
# ---------- end c_script_2 ----------
