# Grasshopper definition 4. Texture.gh (Grasshopper 1.0.4)

panel = Panel("Texturing Pass")
crv = Curve(<curve referenced from the Rhino model>)
bake_now = Button()
panel_2 = Panel(crv)
docstr = CSharpScript(Key="PassingHeight")  # -> out, A; inputs Key: String
# ---------- docstr: C# ----------
    doc = Rhino.RhinoDoc.ActiveDoc;
    for (int i = 0; i < doc.Strings.Count; i++)
    {
      if (String.Equals(doc.Strings.GetKey(i), Key as string, StringComparison.OrdinalIgnoreCase))
        A = doc.Strings.GetValue(i);
    }
# ---------- end docstr ----------
docstr_2 = CSharpScript(Key="Bit Diameter")  # -> out, A; inputs Key: String; same code as docstr
pipeline = GeometryPipeline(
    GroupByLayer=False,
    GroupByType=False,
    IncludeHidden=True,
    IncludeLocked=True,
    LayerFilter="Mold::Finish Surfaces",
    NameFilter="*",
    SublayerFiltering=True,
    TypeFilter=1073741848)
pipeline_2 = GeometryPipeline(
    GroupByLayer=False,
    GroupByType=False,
    IncludeHidden=True,
    IncludeLocked=True,
    LayerFilter="Source::Blank",
    NameFilter="*",
    SublayerFiltering=True,
    TypeFilter=1073741848)
pipeline_3 = GeometryPipeline(
    GroupByLayer=False,
    GroupByType=False,
    IncludeHidden=True,
    IncludeLocked=True,
    LayerFilter="Source::Texture",
    NameFilter="*",
    SublayerFiltering=True,
    TypeFilter=4)
concat = Concatenate(FragmentA="Finishing::Pass ", FragmentB="1/2")
range = Range(Domain=Domain(0, 270), Steps=3)
concat_2 = Concatenate(FragmentA="Finishing ", FragmentB="1/2")
panel_3 = Panel(docstr.A)
panel_4 = Panel(docstr_2.A)
xz = XZPlane(Origin=Point(0, 0, 0))
range_2 = Range(Domain=Domain(0, 18), Steps=3)
vec = VectorXYZ(XComponent=0, YComponent=0, ZComponent=0.25)  # -> Vector, Length
rotate = Rotate(Geometry=crv, Angle=graft(degrees(range)), Plane=xz)  # -> Geometry, Transform
Y = UnitY(Factor=1)
X = UnitX(Factor=1)
move = Move(Geometry=pipeline_2, Motion=vec.Vector)  # -> Geometry, Transform
multiplication = Multiplication(A=X, B=range_2)
multiplication_2 = Multiplication(A=Y, B=16)
division = Division(A="1/2", B="1/8")
dom = ConstructDomain(DomainStart=0, DomainEnd="1/2")
addition = Addition(A=multiplication, B=multiplication_2)
move_2 = Move(Geometry=simplify(rotate.Geometry), Motion=graft(multiplication))  # -> Geometry, Transform
move_3 = Move(Geometry=graft(move.Geometry), Motion=multiplication)  # -> Geometry, Transform
range_3 = Range(Domain=dom, Steps=division)
trim = TrimWithBrep(Curve=move_2.Geometry, Brep=graft(move_3.Geometry))  # -> Inside, Outside
path_mapper = PathMapper(trim.Inside, source="{A;B;C;D}", target="{D}")
path_mapper_2 = PathMapper(trim.Inside, source="{A;B;C;D}", target="{C}")
rev = ReverseList(List=range_3)
vec_2 = VectorXYZ(XComponent=0, YComponent=16, ZComponent=rev)  # -> Vector, Length
crv_2 = Curve(trim.Inside)
graft = GraftTree(Tree=move_2.Geometry, IncludeEmptyLists=True, IncludeNullItems=True)
move_4 = Move(Geometry=graft(path_mapper), Motion=vec_2.Vector)  # -> Geometry, Transform
path_mapper_3 = PathMapper(move_4.Geometry, source="{A;B}", target="{A;0;B}")
branch = TreeBranch(Tree=path_mapper_3, Path="{0;0;0}", MaintainPaths=True)
panel_5 = Panel(path_mapper_3)
item = ListItem(List=branch, Index=Slider(0, range=0..8), Wrap=False)
c_script = CSharpScript(BakeNow=bake_now, Geometry=path_mapper_3, Layer=concat, CacheName=concat_2)  # -> out, A; inputs BakeNow: Boolean, Geometry: tree, Layer: String, CacheName: String
# ---------- c_script: C# ----------
    if (!BakeNow)
      return;

    var doc = Rhino.RhinoDoc.ActiveDoc;
    var result = new System.Text.StringBuilder();
    int layerIndex = 0;
    if (Layer == null)
      layerIndex = doc.Layers.CurrentLayerIndex;
    else
      layerIndex = doc.Layers.FindByFullPath(Layer, 0);
    var key = string.Format("Cache({0})", CacheName);

    // Delete existing cache data
    var existing = doc.Objects.FindByUserString(key, "*", false);
    foreach(RhinoObject obj in existing)
    {
      if (obj.Attributes.LayerIndex == layerIndex)
      {
        doc.Objects.Delete(obj, true);
      }
    }



    // Save geometry to model
    for (int i = 0; i < Geometry.Branches.Count; i++)
    {
      var path = Geometry.Paths[i];
      for (int g = 0; g < Geometry.Branches[i].Count; g++)
      {
        var geo = Geometry.Branches[i][g];
        var attr = new Rhino.DocObjects.ObjectAttributes();
        var cacheValue = string.Format("{0}({1})", path, g);
        attr.SetUserString(key, cacheValue);
        attr.LayerIndex = layerIndex;
        result.Append(cacheValue).Append("\r\n");
        result.Append(geo.GetType()).Append("\r\n");
        if (geo is Rhino.Geometry.Line)
          doc.Objects.AddLine((Rhino.Geometry.Line) geo, attr);
        else
          doc.Objects.Add((Rhino.Geometry.GeometryBase) geo, attr);
      }
    }
    A = result;
# ---------- end c_script ----------
