# Grasshopper definition 6. Cutout Large.gh (Grasshopper 1.0.4)

# ---- group: Curve Inputs
curves_trace_with_bit = Curve([<curve referenced from the Rhino model> x12])
circles_drill_holes = Curve([<curve referenced from the Rhino model> x30])
curves_cut_outside = Curve([<curve referenced from the Rhino model> x25])
curves_cut_inside = Curve(<curve referenced from the Rhino model>)
tolerance = Slider(3, range=0..4)
max_edge_len = Slider(1, range=0..1)
tab_thickness = Slider(0.1, range=0..0.5)
tab_width = Slider(0.375, range=0..0.5)

# ----
tab_count = Slider(4, range=0..6)
depth_pass = Panel(".3")
material_thickness = Panel(".75")
docstr = CSharpScript(Key="Bit Diameter")  # -> out, A; inputs Key: String
# ---------- docstr: C# ----------
    doc = Rhino.RhinoDoc.ActiveDoc;
    for (int i = 0; i < doc.Strings.Count; i++)
    {
      if (String.Equals(doc.Strings.GetKey(i), Key as string, StringComparison.OrdinalIgnoreCase))
        A = doc.Strings.GetValue(i);
    }
# ---------- end docstr ----------

pow = Power(A=10, MaxEdge=max_edge_len)
pow_2 = Power(A=10, Tolerance=tolerance)
one_over_x = OneOverX(Value=pow_2)
one_over_x_2 = OneOverX(Value=pow)

panel = Panel(docstr.A)
extra_cut_depth = Panel("0.05")
panel_2 = Panel(one_over_x)
panel_3 = Panel(one_over_x_2)
addition = Addition(A=material_thickness, B=extra_cut_depth)
addition_2 = Addition(B=tab_width)
division = Division(A=addition_2, B=2)

# ---- group: Holes Larger Than Bit
darc = DeconstructArc(HoleCircles=graft(circles_drill_holes))  # -> BasePlane, Radius, Angle

# ---- group: Move Paths in Z for Cutting Passes
division_2 = Division(A=addition, DepthPass=depth_pass)
bit_radius = Division(Dia=panel, _12=2)
max_depth = Negative(Value=addition)
dom = ConstructDomain(DomainStart=0, DomainEnd=max_depth)
int = Integer(division_2)
equals = Equality(FirstNumber=int, SecondNumber=1)  # -> Equality, Inequality

# ---- group: Holes Equal To Bit Diameter
subtraction = Subtraction(A=darc.Radius, B=bit_radius)
smaller = SmallerThan(FirstNumber=subtraction, SecondNumber=0.0001)  # -> SmallerThan, OrEqualTo
sift = SiftPattern(List=darc.BasePlane, SiftPattern=smaller.OrEqualTo)  # -> Output0, Output1

# ---- group: Holes Larger Than Bit (continued)
equals_2 = Equality(FirstNumber=darc.Radius, SecondNumber=bit_radius)  # -> Equality, Inequality
sift_2 = SiftPattern(List=darc.Radius, SiftPattern=equals_2.Inequality)  # -> Output0, Output1
max_toolpath_radius = Subtraction(A=sift_2.Output1, ToolRadius=bit_radius)
clamp_0 = Maximum(A=max_toolpath_radius, B=0)
division_3 = Division(A=clamp_0, ToolRadius=bit_radius)
range = Range(Domain=clamp_0, Steps=division_3)
toolpaths = Circle(Plane=darc.BasePlane, Radius=range)
clean = CleanTree(RemoveNulls=True, RemoveInvalid=True, RemoveEmpty=False, Tree=toolpaths)  # -> flatten(Tree)

# ---- group: Cut Paths
neg = Negative(Value=bit_radius)
cutout_offset = Offset(CutOutside=curves_cut_outside, Distance=bit_radius, Plane=PlaneXY(0, 0, 0), Corners=1)  # -> flatten(Curve)
pocketing_offset = Offset(CutInside=curves_cut_inside, Distance=neg, Plane=PlaneXY(0, 0, 0), Corners=1)  # -> flatten(Curve)
ins = InsertItems(List=cutout_offset, Item=pocketing_offset, Indices=0, Wrap=True)
clean_2 = CleanTree(RemoveNulls=True, RemoveInvalid=True, RemoveEmpty=False, Tree=ins)

# ----
addition_3 = Addition(A=1, B=int)

# ---- group: Drilling
pdecon = Deconstruct(PlungePoints=sift.Output1)  # -> XComponent, YComponent, ZComponent
pt = ConstructPoint(XCoordinate=pdecon.XComponent, YCoordinate=pdecon.YComponent, ZCoordinate=0.25)
pt_2 = ConstructPoint(XCoordinate=pdecon.XComponent, YCoordinate=pdecon.YComponent, ZCoordinate=max_depth)
drill = Line(StartPoint=pt, EndPoint=pt_2)  # -> flatten(Line)
retract = Line(StartPoint=pt_2, EndPoint=pt)  # disabled
weave = Weave(Pattern=[0, 1], Stream0=drill, Stream1=retract, NullGaps=False)  # -> graft(Weave); disabled

# ----
panel_4 = Panel(pocketing_offset)
crv = Curve(flatten([clean, curves_trace_with_bit, clean_2]))

# ---- group: Move Paths in Z for Cutting Passes (continued)
range_2 = Range(Domain=dom, Steps=addition_3)
filter = StreamFilter(Gate=equals.Equality, Stream0=range_2, Stream1=max_depth)
shift = ShiftList(List=filter, Shift=1, Wrap=False)
vec = VectorXYZ(XComponent=0, YComponent=0, ZComponent=shift)  # -> Vector, Length
move = Move(Geometry=graft(crv), Motion=vec.Vector)  # -> Geometry, Transform
clean_3 = CleanTree(RemoveNulls=True, RemoveInvalid=True, RemoveEmpty=True, Tree=move.Geometry)
simplify = SimplifyTree(Tree=clean_3, Front=False)

# ----
panel_5 = Panel(range_2)
graft = GraftTree(Tree=drill, IncludeEmptyLists=True, IncludeNullItems=True)
simplify_2 = SimplifyTree(Tree=graft, Front=False)
graft_2 = GraftTree(Tree=simplify_2, IncludeEmptyLists=True, IncludeNullItems=True)
cutout_outlines = Curve(clean_2)
topoly = CurveToPolyline(Curve=simplify, ToleranceDistance=one_over_x, ToleranceAngle=0, MaxEdge=one_over_x_2)  # -> Polyline, Segments

# ---- group: Depth of top of tabs
addition_4 = Addition(A=max_depth, B=tab_thickness)
addition_5 = Addition(A=addition_4, B=extra_cut_depth)

# ---- group: Tabs for Holding Parts After Cutting
divide = DivideCurve(Curve=cutout_outlines, Count=tab_count, Kinks=False)  # -> Points, Tangents, Parameters
cir = Circle(Plane=divide.Points, Radius=division)  # -> flatten(Circle)
explode = Explode(Curve=topoly.Polyline, Recursive=True)  # -> Segments, Vertices
incurves = PointInCurves(Point=explode.Vertices, Curves=cir)  # -> Relationship, Index, Point
bool = Boolean(incurves.Relationship)
sift_3 = SiftPattern(List=explode.Vertices, SiftPattern=bool)  # -> Output0, Output1
pdecon_2 = Deconstruct(Point=sift_3.Output1)  # -> XComponent, YComponent, ZComponent
max = Maximum(A=pdecon_2.ZComponent, B=addition_5)
pt_3 = ConstructPoint(XCoordinate=pdecon_2.XComponent, YCoordinate=pdecon_2.YComponent, ZCoordinate=max)
combine = CombineData(Input0=sift_3.Output0, Input1=pt_3)  # -> Result, Index
toolpaths_2 = PolyLine(Vertices=combine.Result, Closed=False)

# ----
path_mapper = PathMapper(toolpaths_2, source="{A;B}", target="{A+100;B}")
panel_6 = Panel(toolpaths_2)
merge = Merge(Data1=graft_2, Data2=path_mapper)
trim = TrimTree(Tree=merge, Depth=1)
path_mapper_2 = PathMapper(trim, source="{A}", target="{path_index}")
panel_7 = Panel(path_mapper_2)
c_script = CSharpScript(BakeNow=Button(), Geometry=path_mapper_2, CacheName="Toolpaths")  # -> out, A; inputs BakeNow: Boolean, Geometry: tree, Layer: String, CacheName: String
# ---------- c_script: C# ----------
    if (!BakeNow)
      return;

    var doc = Rhino.RhinoDoc.ActiveDoc;
    var result = new System.Text.StringBuilder();
    int layerIndex = 0;
    if (Layer == null)
      layerIndex = doc.Layers.CurrentLayerIndex;
    else
      layerIndex = doc.Layers.FindByFullPath(Layer, 0);
    var key = string.Format("Cache({0})", CacheName);

    // Delete existing cache data
    var existing = doc.Objects.FindByUserString(key, "*", false);
    foreach(RhinoObject obj in existing)
    {
      if (obj.Attributes.LayerIndex == layerIndex)
      {
        doc.Objects.Delete(obj, true);
      }
    }



    // Save geometry to model
    for (int i = 0; i < Geometry.Branches.Count; i++)
    {
      var path = Geometry.Paths[i];
      for (int g = 0; g < Geometry.Branches[i].Count; g++)
      {
        var geo = Geometry.Branches[i][g];
        var attr = new Rhino.DocObjects.ObjectAttributes();
        var cacheValue = string.Format("{0}({1})", path, g);
        attr.SetUserString(key, cacheValue);
        attr.LayerIndex = layerIndex;
        result.Append(cacheValue).Append("\r\n");
        result.Append(geo.GetType()).Append("\r\n");
        if (geo is Rhino.Geometry.Line)
          doc.Objects.AddLine((Rhino.Geometry.Line) geo, attr);
        else
          doc.Objects.Add((Rhino.Geometry.GeometryBase) geo, attr);
      }
    }
    A = result;
# ---------- end c_script ----------
