# Grasshopper definition 7. Pocketing.gh (Grasshopper 1.0.4)

taper_curve = Curve(<curve referenced from the Rhino model>)
bake_now = Button()
cache_name = Panel("Pocketing")
layer_name = Panel("Pocket Toolpaths")
depth_of_pocket = Slider(0.5, range=0..2)
depth_of_pass = Slider(0.13, range=0..2)
taper_pass_depth = Slider(0.06, range=0..0.3)
rib_thickness = Panel(".25")
tool_diameter = Panel(".25")
contour_offset = Panel(".1")
input_curves = Curve([<curve referenced from the Rhino model> x65])

# ---- group: Tapered Profile Offset Computation
bbox = BoundingBox(Content=taper_curve, Plane=PlaneXY(0, 0, 0))  # -> Box, Box_2
debox = DeconstructBox(Box=bbox.Box)  # -> Plane, X, Y, Z
dedomain = DeconstructDomain(Domain=debox.Y)  # -> Start, End
taper_pass_count = Subtraction(A=dedomain.End, B=dedomain.Start)
division = Division(A=taper_pass_count, B=taper_pass_depth)
multiplication = Multiplication(A=taper_pass_count, B=taper_pass_depth)
subtraction = Subtraction(A=division, B=1)
dom = ConstructDomain(DomainStart=taper_pass_depth, DomainEnd=multiplication)
range = Range(Domain=dom, Steps=subtraction)
xz = XZPlane(Origin=Point(0, 0, 0))
contour = ContourEx(Curve=taper_curve, Plane=xz, Distances=range)  # -> Contours, Parameters
division_2 = Division(A=rib_thickness, B=2)
pt = Point(contour.Contours)
pdecon = Deconstruct(Point=pt)  # -> XComponent, YComponent, ZComponent
smaller = SmallerThan(FirstNumber=pdecon.XComponent, SecondNumber=division_2)  # -> SmallerThan, OrEqualTo
sift = SiftPattern(List=pt, SiftPattern=smaller.SmallerThan)  # -> Output0, simplify(flatten(Output1))

# ----
division_3 = Division(A=rib_thickness, B=-2)
amoments = AreaMoments(Geometry=input_curves)  # -> Area, Centroid, Inertia, InertiaError, Secondary, SecondaryError, Gyration
division_4 = Division(A=depth_of_pocket, B=depth_of_pass)
multiplication_2 = Multiplication(A=division_4, B=3)
pt_2 = Point(amoments.Centroid)

# ---- group: Vertical slices / Roughing slices
range_2 = Range(Domain=depth_of_pocket, Steps=division_4)
shift = ShiftList(List=range_2, Shift=1, Wrap=False)
neg = Negative(Value=shift)
vec = VectorXYZ(XComponent=0, YComponent=0, ZComponent=neg)  # -> Vector, Length

# ---- group: Finishing slices
range_3 = Range(Domain=depth_of_pocket, Steps=multiplication_2)
shift_2 = ShiftList(List=range_3, Shift=1, Wrap=False)
neg_2 = Negative(Value=shift_2)
vec_2 = VectorXYZ(XComponent=0, YComponent=0, ZComponent=neg_2)  # -> Vector, Length

# ----
sort_pt = SortPoints(Points=pt_2)  # -> Points, Indices
item = ListItem(List=input_curves, Index=sort_pt.Indices, Wrap=True)
input_curves_2 = Curve(item)
offset = Offset(Curve=input_curves_2, Distance=division_3, Plane=PlaneXY(0, 0, 0), Corners=1)
inputs = Curve(flatten(offset))

# ---- group: Pocket Finishing
division_5 = Division(A=tool_diameter, B=-2)
offset_2 = Offset(Curve=inputs, Distance=division_5, Plane=PlaneXY(0, 0, 0), Corners=1)
simplify = SimplifyTree(Tree=offset_2, Front=False)
move = Move(Geometry=graft(simplify), Motion=vec_2.Vector)  # -> Geometry, Transform
path_mapper = PathMapper(move.Geometry, source="{A;B;C}", target="{C;100}")

# ---- group: Pocket roughing
division_6 = Division(A=tool_diameter, B=-1.8)
offset_3 = Offset(Curve=inputs, Distance=division_6, Plane=PlaneXY(0, 0, 0), Corners=1)
division_7 = Division(A=division_5, B=2)
simplify_2 = SimplifyTree(Tree=offset_3, Front=False)
contour_2 = Contour(Curve=simplify_2, Point=Point(0, 0, 0), Direction=Vector(0.25, 0, 0), Distance=contour_offset)  # -> Contours, Parameters
cullpt = CullDuplicates(Points=contour_2.Contours, Tolerance=0.1, CullMode=3)  # -> Points, Indices, Valence
sort_pt_2 = SortPoints(Points=cullpt.Points)  # -> Points, Indices
dispatch = Dispatch(List=sort_pt_2.Points, DispatchPattern=[True, False])  # -> ListA, ListB
pt_3 = Point(dispatch.ListA)
pt_4 = Point(dispatch.ListB)
ln = Line(StartPoint=pt_3, EndPoint=pt_4)
move_2 = Move(Geometry=graft(ln), Motion=vec.Vector)  # -> simplify(graft(Geometry)), Transform
path_mapper_2 = PathMapper(move_2.Geometry, source="{A;B;C}", target="{A;C}")

# ----
additional_taper_offset = Panel("0")

# ---- group: Create Tapered Toolpaths
clean = CleanTree(RemoveNulls=True, RemoveInvalid=True, RemoveEmpty=True, Tree=sift.Output1)
pdecon_2 = Deconstruct(Point=clean)  # -> XComponent, YComponent, ZComponent
neg_3 = Negative(Value=pdecon_2.XComponent)
Z = UnitZ(Factor=1)
addition = Addition(A=division_6, B=neg_3)
multiplication_3 = Multiplication(A=pdecon_2.YComponent, B=Z)
addition_2 = Addition(A=addition, B=additional_taper_offset)
offset_4 = Offset(Curve=graft(input_curves_2), Distance=addition_2, Plane=PlaneXY(0, 0, 0), Corners=1)
simplify_3 = SimplifyTree(Tree=offset_4, Front=False)
trim = TrimTree(Tree=simplify_3, Depth=1)
move_3 = Move(Geometry=trim, Motion=multiplication_3)  # -> Geometry, Transform
path_mapper_3 = PathMapper(move_3.Geometry, source="{A}", target="{A;200}")

# ----
panel = Panel(clean)
crv = Curve([path_mapper, path_mapper_2, path_mapper_3])

# ---- group: Tree Explorer
crv_2 = Curve(simplify(crv))
object = Slider(0, range=0..31)
layer = Slider(0, range=0..31)
move_4 = Slider(0, range=0..11)
panel_2 = Panel(crv_2)
path_mapper_4 = PathMapper(crv_2, source="{A;B}", target="{A;B}")
concat = Concatenate(FragmentA=object, FragmentB=";", FragmentC=layer)
branch = TreeBranch(Tree=path_mapper_4, Path=concat, MaintainPaths=True)
panel_3 = Panel(path_mapper_4)
item_2 = ListItem(List=branch, Index=move_4, Wrap=False)

# ----
clean_2 = CleanTree(RemoveNulls=True, RemoveInvalid=True, RemoveEmpty=True, Tree=crv)
panel_4 = Panel(clean_2)
c_script = CSharpScript(BakeNow=bake_now, Geometry=clean_2, Layer=layer_name, CacheName=cache_name)  # -> out, A; inputs BakeNow: Boolean, Geometry: tree, Layer: String, CacheName: String
# ---------- c_script: C# ----------
    if (!BakeNow)
      return;

    var doc = Rhino.RhinoDoc.ActiveDoc;
    var result = new System.Text.StringBuilder();
    int layerIndex = 0;
    if (Layer == null)
      layerIndex = doc.Layers.CurrentLayerIndex;
    else
      layerIndex = doc.Layers.FindByFullPath(Layer, 0);
    var key = string.Format("Cache({0})", CacheName);

    // Delete existing cache data
    var existing = doc.Objects.FindByUserString(key, "*", false);
    foreach(RhinoObject obj in existing)
    {
      if (obj.Attributes.LayerIndex == layerIndex)
      {
        doc.Objects.Delete(obj, true);
      }
    }



    // Save geometry to model
    for (int i = 0; i < Geometry.Branches.Count; i++)
    {
      var path = Geometry.Paths[i];
      for (int g = 0; g < Geometry.Branches[i].Count; g++)
      {
        var geo = Geometry.Branches[i][g];
        var attr = new Rhino.DocObjects.ObjectAttributes();
        var cacheValue = string.Format("{0}({1})", path, g);
        attr.SetUserString(key, cacheValue);
        attr.LayerIndex = layerIndex;
        result.Append(cacheValue).Append("\r\n");
        result.Append(geo.GetType()).Append("\r\n");
        if (geo is Rhino.Geometry.Line)
          doc.Objects.AddLine((Rhino.Geometry.Line) geo, attr);
        else
          doc.Objects.Add((Rhino.Geometry.GeometryBase) geo, attr);
      }
    }
    A = result;
# ---------- end c_script ----------
panel_5 = Panel(crv)
c_script_2 = CSharpScript(BakeNow=Button(), CacheName="Toolpaths")  # -> out, A; inputs BakeNow: Boolean, Geometry: tree, Layer: String, CacheName: String; same code as c_script
