# Grasshopper definition 9. Machine.gh (Grasshopper 1.0.4)
# plug-ins: EleFront

roughing_1 = GeometryCache(MaintainReferences=False)
roughing_2 = GeometryCache(MaintainReferences=False)
finishing_1_4 = GeometryCache(MaintainReferences=False)
# Instructions: Inputs:
#   Bit Diameter (Document User String)
#   PassingHeight (Document User String)
#   Toolpaths (Curves with Object User Strings)
# 
# Configuration:
#   Spindle speed (this drives
# 
# Input curves can be on any layer.
# All input geometry has a UserString key of
# 
#   Cache(Toolpaths)
# 
# The value of the UserString is a path and list index so that a collection of curves can be reconstituted into a tree with one layer:
# 
# {0}
#  crv1
#  crv2
#  crv3
# {1}
#  crv1
#  crv2
# {2}
#  crv1
# {3}
#  crv1
#  crv2
#  crv3
#  crv4
# ...
# 
# Each branch represents a cutting operation with one or more toolpaths. This definition creates a vertical entry path to the start of the first curve, and a vertical exit path from the end of the last curve. Odd numbered paths will be reversed so that the tool can descend one layer and trace back through the previous cut.
finishing_1_2 = GeometryCache(MaintainReferences=False)
finishing_3_8 = GeometryCache(MaintainReferences=False)
panel = Panel("Machining Pass")
save_now = Button()
x_offset = Slider(0, range=0..8)
y_offset = Slider(2, range=0..6)
spindle_speed = Slider(5, range=1..6)
cut = Button()
pause = Button()
resume = Button()
quit = Button()
activedoc = CSharpScript()  # -> out, Folder, Name
# ---------- activedoc: C# ----------
    Folder = System.IO.Path.GetDirectoryName(RhinoDoc.ActiveDoc.Path);
    Name = System.IO.Path.GetFileNameWithoutExtension(RhinoDoc.ActiveDoc.Name);
# ---------- end activedoc ----------
crv = Curve(finishing_3_8)
vec = VectorXYZ(XComponent="3", YComponent="1.25", ZComponent=0)  # -> Vector, Length
docstr = CSharpScript(Key="PassingHeight")  # -> out, A; inputs Key: String
# ---------- docstr: C# ----------
    doc = Rhino.RhinoDoc.ActiveDoc;
    for (int i = 0; i < doc.Strings.Count; i++)
    {
      if (String.Equals(doc.Strings.GetKey(i), Key as string, StringComparison.OrdinalIgnoreCase))
        A = doc.Strings.GetValue(i);
    }
# ---------- end docstr ----------
docstr_2 = CSharpScript(Key="Bit Diameter")  # -> out, A; inputs Key: String; same code as docstr
item = ListItem(List=flatten(crv), Index=0, Wrap=True)
panel_2 = Panel(docstr_2.A)
panel_3 = Panel(docstr.A)
chip_load = Panel(".01")
crv_2 = Curve(item)
remap = RemapNumbers(Value=spindle_speed, Source=Domain(1, 6), Target=Domain(16000, 27000))  # -> Mapped, Clipped
tool = CSharpScript(cl=chip_load, dia=0.25, fl=2, sp=remap.Mapped)  # -> out, RPM, FR
# ---------- tool: C# ----------
// ChipLoad x CutterDiameter x NumberOfFlutes x SpindleSpeed = FeedRate
// ChipLoad = amout of material cut per tooth
// FeedRate = surface speed of tool in inches per minute
// SpindleSpeed = rotational speed of tool, RPM

var _fr  = Convert.ToDouble(fr);
var _sp  = Convert.ToDouble(sp);
var _cl  = Convert.ToDouble(cl);
var _dia = Convert.ToDouble(dia);
var _fl  = Convert.ToDouble(fl);


if (_fr == 0.0 && _sp == 0.0) {
  RPM = 0;
  FR = 0;
}
else if (_fr == 0.0)
{
  // Solve for Feed Rate
  FR = (_cl * _dia * _fl * _sp) / 60;
  RPM = _sp;
}
else if (_sp == 0.0)
{
  // Solve for Spindle Speed
  RPM = _fr / (_cl * _dia * _fl);
  FR = _fr;
}
else
{
  // print("Warning: cannot specify both feed rate and spindle speed");
  FR = 0;
  RPM = 0;
}
# ---------- end tool ----------
remap_2 = RemapNumbers(Value=tool.RPM, Source=Domain(16000, 27000), Target=Domain(1, 6))  # -> Mapped, Clipped
feed_rate = Panel(tool.FR)
spindle_speed_2 = Panel(remap_2.Mapped)
passing_height = Number(panel_3)
vec_2 = VectorXYZ(XComponent="3", YComponent="1.25", ZComponent=0)  # -> Vector, Length
division = Division(A=tool.FR, B=2)

# ---- group: Trim curves to machine volume
# This section produces data in the form
# 
# {
#   Object,
#   Layer,
#   Sub-Layer
# }
# (Move)
brep = Brep(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)
crv_3 = Curve(crv)
bbox = BoundingBox(Content=brep, Plane=PlaneXY(0, 0, 0))  # -> Box, Box_2
debox = DeconstructBox(Box=bbox.Box)  # -> Plane, X, Y, Z
dedomain = DeconstructDomain(Domain=debox.Y)  # -> Start, End
dedomain_2 = DeconstructDomain(Domain=debox.X)  # -> Start, End
multiplication = Multiplication(A=dedomain.End, B=y_offset)
X = UnitX(Factor=1)
Y = UnitY(Factor=1)
multiplication_2 = Multiplication(A=multiplication, B=Y)

# ----
subtraction = Subtraction(A=dedomain_2.End, B=dedomain_2.Start)
panel_4 = Panel(crv_3)

# ---- group: Trim curves to machine volume (continued)
multiplication_3 = Multiplication(A=subtraction, B=x_offset)
multiplication_4 = Multiplication(A=multiplication_3, B=X)
addition = Addition(A=multiplication_4, B=multiplication_2)
move = Move(Geometry=brep, Motion=addition)  # -> Geometry, Transform
trim = TrimWithBrep(Curve=crv_3, Brep=move.Geometry)  # -> Inside, Outside
trim_2 = TrimTree(Tree=trim.Inside, Depth=1)
crv_4 = Curve(trim_2)

# ----
input_geometry = Curve(crv_4)

# ---- group: One curve becomes several; rearrange tree to make individual top level branches
crv_5 = Curve(crv_4)
sift = SiftPattern(List=crv_5, SiftPattern=[0, 1])  # -> Output0, Output1

# ----
panel_5 = Panel(crv_4)

# ---- group: Connect Right Ends of Curves
flip = FlipCurve(Curve=sift.Output1)  # -> Curve, Flag
end = EndPoints(Curve=flip.Curve)  # -> Start, End
shift = ShiftList(List=end.End, Shift=1, Wrap=False)
clean = CleanTree(RemoveNulls=True, RemoveInvalid=True, RemoveEmpty=False, Tree=shift)

# ---- group: Connect Left Ends of Curves
crv_6 = Curve(sift.Output0)
end_2 = EndPoints(Curve=crv_6)  # -> Start, End
pt = Point(end_2.End)
shift_2 = ShiftList(List=pt, Shift=-1, Wrap=False)
clean_2 = CleanTree(RemoveNulls=True, RemoveInvalid=True, RemoveEmpty=False, Tree=shift_2)
clean_3 = CleanTree(RemoveNulls=True, RemoveInvalid=True, RemoveEmpty=False, Tree=end.Start)
ln = Line(StartPoint=clean_2, EndPoint=clean_3)

# ---- group: Connect Right Ends of Curves (continued)
shift_3 = ShiftList(List=end_2.Start, Shift=1, Wrap=False)
clean_4 = CleanTree(RemoveNulls=True, RemoveInvalid=True, RemoveEmpty=False, Tree=shift_3)
short = ShortestList(ListA=clean_4, ListB=clean, TrimMode=2)  # -> ListA, ListB
ln_2 = Line(StartPoint=short.ListB, EndPoint=short.ListA)

# ---- group: Connect Toolpath Layers
clean_5 = CleanTree(RemoveNulls=True, RemoveInvalid=True, RemoveEmpty=True, Tree=crv_6)
trim_3 = TrimTree(Tree=ln, Depth=1)
clean_6 = CleanTree(RemoveNulls=True, RemoveInvalid=True, RemoveEmpty=False, Tree=flip.Curve)
trim_4 = TrimTree(Tree=ln_2, Depth=1)

# ----
clean_7 = CleanTree(RemoveNulls=True, RemoveInvalid=True, RemoveEmpty=True, Tree=trim_3)
clean_8 = CleanTree(RemoveNulls=True, RemoveInvalid=True, RemoveEmpty=True, Tree=trim_4)

# ---- group: Connect Toolpath Layers (continued)
weave = Weave(Pattern=[0, 1, 2, 3], Stream0=clean_5, Stream1=clean_7, Stream2=clean_6, Stream3=clean_8, NullGaps=False)

# ---- group: Last Curve
lng = ListLength(List=weave)
subtraction_2 = Subtraction(A=lng, B=1)
item_2 = ListItem(List=weave, Index=subtraction_2, Wrap=False)
end_3 = EndPoints(Curve=item_2)  # -> Start, End

# ---- group: First Curve
item_3 = ListItem(List=weave, Index=0, Wrap=True)
end_4 = EndPoints(Curve=item_3)  # -> Start, End

# ---- group: Create Entry Path
pdecon = Deconstruct(Point=end_4.Start)  # -> XComponent, YComponent, ZComponent
pt_2 = ConstructPoint(XCoordinate=pdecon.XComponent, YCoordinate=pdecon.YComponent, ZCoordinate=passing_height)
ln_3 = Line(StartPoint=pt_2, EndPoint=end_4.Start)

# ---- group: Create Exit Path
pdecon_2 = Deconstruct(Point=end_3.End)  # -> XComponent, YComponent, ZComponent
pt_3 = ConstructPoint(XCoordinate=pdecon_2.XComponent, YCoordinate=pdecon_2.YComponent, ZCoordinate=passing_height)
ln_4 = Line(StartPoint=end_3.End, EndPoint=pt_3)

# ---- group: Connect Entry and Exit Paths
ins = InsertItems(List=weave, Item=ln_3, Indices=0, Wrap=False)
lng_2 = ListLength(List=ins)
ins_2 = InsertItems(List=ins, Item=ln_4, Indices=lng_2, Wrap=False)

# ----
crv_7 = Curve(ins_2)

# ---- group: Tree Explorer
object = Slider(7, range=0..31)
move_2 = Slider(0, range=0..11)
layer = Slider(9, range=0..31)
crv_8 = Curve(weave)
panel_6 = Panel(crv_8)
path_mapper = PathMapper(crv_8, source="{A;B;C}", target="{A;C}")
concat = Concatenate(FragmentA=object, FragmentB=";", FragmentC=layer)
branch = TreeBranch(Tree=path_mapper, Path=concat, MaintainPaths=True)
panel_7 = Panel(path_mapper)
item_4 = ListItem(List=branch, Index=move_2, Wrap=False)

# ----
panel_8 = Panel(weave)

# ---- group: Filename
rhatt = GetRhinoAttributes(Geometry=crv_7, readFullPath=True)  # -> Name, Layer, Color
rep = ReplaceText(Text=rhatt.Layer, Find="::", Replace=" - ", RecursiveReplace=False)
concat_2 = Concatenate(FragmentA=activedoc.Name, FragmentB=" - ")
concat_3 = Concatenate(FragmentA=concat_2, FragmentB=rep)

# ---- group: Move curves to machine origin
neg = Negative(Value=addition)
move_3 = Move(Geometry=crv_7, Motion=neg)  # -> Geometry, Transform

# ---- group: Create Toopath Points
topoly = CurveToPolyline(Curve=move_3.Geometry, ToleranceDistance=0.005, ToleranceAngle=0)  # -> Polyline, Segments
explode = Explode(Curve=topoly.Polyline, Recursive=True)  # -> Segments, Vertices
clean_9 = CleanTree(RemoveNulls=True, RemoveInvalid=True, RemoveEmpty=True, Tree=explode.Vertices)

# ----
final_toolpath = Curve(topoly.Polyline)
move_4 = Move(Geometry=final_toolpath, Motion=vec.Vector)  # -> Geometry, Transform
panel_9 = Panel(move_4.Geometry)
path_mapper_2 = PathMapper(weave, source="{A;B;C}", target="{A;C}")
move_5 = Move(Geometry=clean_9, Motion=vec_2.Vector)  # -> Geometry, Transform

# ---- group: Part File
m3 = CSharpScript(pts=move_5.Geometry, passingHeight=passing_height)  # -> out, flatten(A); inputs pts: list
# ---------- m3: C# ----------
    // Convert each point in incoming point list to ShopBot M3 command
    System.Text.StringBuilder result = new System.Text.StringBuilder();
    double _passingHeight = 0.5;
    if (passingHeight != null)
      double.TryParse(passingHeight as string, out _passingHeight);
    foreach (var p in pts)
    {
      var pt = (Rhino.Geometry.Point3d) p;
      if (pt.Z >= _passingHeight)
        result.Append("J3 ");
      else
        result.Append("M3 ");

      result.Append(pt.X.ToString("N4")).Append(",");
      result.Append(pt.Y.ToString("N4")).Append(",");
      result.Append(pt.Z.ToString("N4"));
      result.Append("\n");
    }
    A = result.ToString();
# ---------- end m3 ----------
feeds = CSharpScript(mxy=tool.FR, mz=division, jxy=5, jz=5)  # -> out, VS
# ---------- feeds: C# ----------
    VS = string.Format("VS {0:N4}, {1:N4}, 1, 1, {2}, {3}, 1, 1", mxy, mz, jxy, jz);
# ---------- end feeds ----------
header = Panel("""SO 1,1  ' Turn on router
Pause 2 ' Wait 2 seconds
SA      ' Absolute mode""")
footer = Panel("""'MZ 0.25
SO 1,0  ' Turn off router""")
sbp_file = Panel([header, feeds.VS, m3.A, footer])
ascii_file = CSharpScript(Content=sbp_file, Directory=activedoc.Folder, Filename=concat_3, Write=save_now)  # -> output, path; inputs Content: list
# ---------- ascii_file: C# ----------
    // Write ASCII file to path
    var result = new System.Text.StringBuilder();

    var dir = (String) Directory;
    var file = Filename as String;

    var existing = System.IO.Directory.GetFiles(dir, file + " *");
    int max_index = 0;
    foreach (var e in existing) {
      result.Append("Reading ").Append(e).Append("\r\n");
      var n = e.Replace(System.IO.Path.Combine(dir, file + " "), "");
      n = n.Replace(".sbp", "");
      result.Append("Converting to int: ").Append(n);
      int e_index;
      if (int.TryParse(n, out e_index))
      {
        max_index = Math.Max(max_index, e_index);
        result.Append(" ... success! ").Append(max_index.ToString()).Append("\r\n");
      }
      else {
        result.Append(" ... failed\n").Append("\r\n");
      }
    }

    var this_index = max_index + 1;
    var last_written = file + " " + max_index.ToString("D4") + ".sbp";

    file += " " + this_index.ToString("D4") + ".sbp";


    result.Append("Saving to: ").Append(file);

    var fullpath = System.IO.Path.Combine(dir, file);
    path = last_written;

    bool write = (bool) Write;
    if (write) {
      var sb = new System.Text.StringBuilder();
      foreach (object s in Content) {
        sb.Append((string) s).Append("\r\n");
      }

      System.IO.File.WriteAllText(fullpath, sb.ToString());
    }

    output = result.ToString();
# ---------- end ascii_file ----------

# ----
project_name = Panel(ascii_file.output)
fabmopost = CSharpScript(
    CutNow=cut,
    Pause=pause,
    Resume=resume,
    Quit=quit,
    IP="192.168.42.1",
    SBPFile=sbp_file,
    Reference="C:\Windows\assembly\NativeImages_v4.0.30319_64\System.Net.Http\d9673165e138070d27961581a90e5e1b\System.Net.Http.ni.dll")  # -> out, status, sent_file; inputs CutNow: Boolean, Pause: Boolean, Resume: Boolean, Quit: Boolean, IP: String, SBPFile: tree of String
# ---------- fabmopost: C# ----------
    var client = new System.Net.Http.HttpClient();

    // Clean up duplicate points in SBP file
    var clean_file = new System.Text.StringBuilder();
    foreach (var branch in SBPFile.Branches)
    {
      foreach (var element in branch) {
        var lines = System.Text.RegularExpressions.Regex.Split(element, "\r\n|\r|\n");
        foreach (var line in lines)
        {
          if (line == _last_line)
          {
            //clean_file.Append("' Removed ").Append(line).Append("\r\n");
            continue;
          }
          else if (string.IsNullOrWhiteSpace(line))
          {
            //clean_file.Append("' Skipping blank line").Append("\r\n");
            continue;
          }
          else {
            clean_file.Append(line);
            //clean_file.Append("  ' >>> ").Append(_last_line);
            clean_file.Append("\r\n");
            //clean_file.Append("--\r\n");
            //clean_file.Append("' Setting last_line to: >").Append(line).Append("<\r\n");
            _last_line = line;
          }
        }
        clean_file.Append("\r\n");
      }
      clean_file.Append("\r\n\r\n");
    }
    var pairs = new List<KeyValuePair<string, string>>
      {
        new KeyValuePair<string, string>("runtime", "sbp"),
        new KeyValuePair<string, string>("cmd", clean_file.ToString())
        };

    if (CutNow)
    {
      var content = new FormUrlEncodedContent(pairs);

      var url = string.Format("http://{0}/code", IP);
      var response = client.PostAsync(url, content).Result;
      _status = string.Format("Cutting ({0})", response.StatusCode);
    }
    else if (Pause)
    {
      var url = string.Format("http://{0}/pause", IP);
      var response = client.PostAsync(url, null).Result;
      _status = string.Format("Pausing ({0})", response.StatusCode);
    }
    else if (Quit)
    {
      var url = string.Format("http://{0}/quit", IP);
      var response = client.PostAsync(url, null).Result;
      _status = string.Format("Quitting ({0})", response.StatusCode);
    }
    else if (Resume)
    {
      var url = string.Format("http://{0}/resume", IP);
      var response = client.PostAsync(url, null).Result;
      _status = string.Format("Resume Cutting ({0})", response.StatusCode);
    }

    status = _status;
    sent_file = clean_file.ToString();
# ---------- fabmopost: C# additional code ----------
  string _status = "Idle";
  string _last_line = "";
# ---------- end fabmopost ----------
panel_10 = Panel(fabmopost.status)
trim_5 = TrimTree(Tree=ins_2, Depth=2)
panel_11 = Panel(path_mapper_2)
