# Grasshopper definition voronoi attractor plates.gh (Grasshopper 1.0.4)
# plug-ins: LunchBox

md_slider = MDSlider(
    slider_value=Point(0.4146044196, 0.5722539948, 0.5),
    SliderMode=0,
    x_domain=Domain(-10, 20),
    y_domain=Domain(-15, 15),
    z_domain=Domain(0, 1))
md_slider_2 = MDSlider(
    slider_value=Point(0.5262929405, 0.7612360512, 0.5),
    SliderMode=0,
    x_domain=Domain(-10, 20),
    y_domain=Domain(-15, 15),
    z_domain=Domain(0, 1))
md_slider_3 = MDSlider(
    slider_value=Point(0.5323507262, 0.5078234789, 0.5),
    SliderMode=0,
    x_domain=Domain(-10, 20),
    y_domain=Domain(-15, 15),
    z_domain=Domain(0, 1))
range = Range(Domain=Domain(0, 8), Steps=10)
pt = Point(<point referenced from the Rhino model>)
Y = UnitY(Factor=1)
range_2 = Range(Domain=Domain(0, 12), Steps=10)
X = UnitX(Factor=1)
crv = Curve(<curve referenced from the Rhino model>)
multiplication = Multiplication(A=Y, B=range)
multiplication_2 = Multiplication(A=X, B=range_2)
pt_2 = Point([md_slider_3, md_slider_2, md_slider])
addition = Addition(A=graft(multiplication), B=multiplication_2)
number_slider = Slider(4, range=1..10)
move = Move(Geometry=pt, Motion=addition)  # -> flatten(Geometry), Transform
panel = Panel(move.Geometry)
attract = Attractor(AttractorPoints=pt_2, TargetPoints=move.Geometry, AttractorDomain=flatten(Slider(10, range=1..10)))  # -> Values, Vectors, Distances
move_2 = Move(Geometry=pt_2, Motion=attract.Vectors)  # -> Geometry, Transform
voronoi = Voronoi(Points=move_2.Geometry, Boundary=crv, BruteForceOverride=False)
