# Grasshopper definition voronoi randomness.gh (Grasshopper 1.0.4)
# plug-ins: Kangaroo2 Components

x_range = Slider(18, range=1..18)
seeds = Slider(100, range=1..100)
y_seed = Slider(130, range=100..150)
y_seed_2 = Slider(32, range=0..50)
closest_distance = Slider(0.504, range=0..2)
y_range = Slider(8, range=1..12)
crv = Curve(<curve referenced from the Rhino model>)
subtraction = Subtraction(A=y_range, B=0.5)
subtraction_2 = Subtraction(A=x_range, B=0.5)
dom = ConstructDomain(DomainStart=0.5, DomainEnd=subtraction)
dom_2 = ConstructDomain(DomainStart=0.5, DomainEnd=subtraction_2)
random = Random(Range=dom, Number=seeds, Seed=y_seed_2)  # -> flatten(Random)
random_2 = Random(Range=dom_2, Number=seeds, Seed=y_seed)  # -> flatten(Random)
pt = ConstructPoint(XCoordinate=random_2, YCoordinate=random, ZCoordinate=0)  # -> flatten(Point)
ms = MagnetSnap(Points=pt, Range=closest_distance, Strength=10)
solver = Solver(GoalObjects=ms, Reset=Button(), Threshold=1e-15, Tolerance=0.01, On=True)  # -> I, V, O
cullpt = CullDuplicates(Points=solver.V, Tolerance=0.1, CullMode=3)  # -> Points, Indices, Valence
voronoi = Voronoi(Points=cullpt.Points, Boundary=crv, BruteForceOverride=False)
