# Grasshopper definition voronoi roll plate - symmetrical.gh (Grasshopper 1.0.4)
# plug-ins: Kangaroo2 Components

button = Button()
closest_distance = Slider(0.128, range=0..2)
x_range = Slider(7, range=1..18)
seeds = Slider(78, range=1..200)
y_seed = Slider(133, range=100..150)
y_seed_2 = Slider(44, range=0..50)
y_range = Slider(7, range=1..22)
recompute = Button()
multiplication = Multiplication(A=y_range, B=2)

# ---- group: Random Points
subtraction = Subtraction(A=x_range, B=0.5)
subtraction_2 = Subtraction(A=y_range, B=0.5)
dom = ConstructDomain(DomainStart=0.5, DomainEnd=subtraction)
dom_2 = ConstructDomain(DomainStart=0.5, DomainEnd=subtraction_2)
random = Random(Range=dom, Number=seeds, Seed=y_seed)  # -> flatten(Random)
random_2 = Random(Range=dom_2, Number=seeds, Seed=y_seed_2)  # -> flatten(Random)
pt = ConstructPoint(XCoordinate=random, YCoordinate=random_2, ZCoordinate=0)  # -> flatten(Point)

# ----
multiplication_2 = Multiplication(A=y_range, B=0.2)
rectangle = Rectangle(Plane=PlaneXY(0, 0, 0), XSize=x_range, YSize=multiplication, Radius=0)  # -> Rectangle, Length
voronoi = Voronoi(Points=[<geometry referenced from the Rhino model> x65], Boundary=rectangle.Rectangle, BruteForceOverride=False)
neg = Negative(Value=multiplication_2)
dom_3 = ConstructDomain(DomainStart=neg, DomainEnd=multiplication_2)
pt_2 = ConstructPoint(XCoordinate=0, YCoordinate=y_range, ZCoordinate=0)

# ---- group: Mirror
pt_3 = ConstructPoint(XCoordinate=0, YCoordinate=y_range, ZCoordinate=0)
xz = XZPlane(Origin=pt_3)
mirror = Mirror(Geometry=pt, Plane=xz)  # -> Geometry, Transform

# ----
pt_4 = Point([pt, mirror.Geometry])

# ---- group: Randomize Points near middle
rectangle_2 = Rectangle(Plane=pt_2, XSize=x_range, YSize=dom_3, Radius=0)  # -> Rectangle, Length
incurve = PointInCurve(Point=pt_4, Curve=rectangle_2.Rectangle)  # -> Relationship, Point
sift = SiftPattern(List=pt_4, SiftPattern=incurve.Relationship)  # -> Output0, Output1, Output2
pt_5 = Point(sift.Output2)
lng = ListLength(List=pt_5)
random_3 = Random(Range=Domain(-0.5, 0.5), Number=lng, Seed=2)
shift = ShiftList(List=random_3, Shift=3, Wrap=True)
vec = VectorXYZ(XComponent=random_3, YComponent=shift, ZComponent=0)  # -> Vector, Length
move = Move(Geometry=pt_5, Motion=vec.Vector)  # -> Geometry, Transform

# ----
combine = CombineData(Input0=sift.Output0, Input1=sift.Output1, Input2=move.Geometry)  # -> Result, Index

# ---- group: Cull points that are too near
ms = MagnetSnap(Points=combine.Result, Range=closest_distance, Strength=1)
solver = Solver(GoalObjects=ms, Reset=recompute, Threshold=1e-15, Tolerance=0.01, On=True)  # -> I, V, O
cullpt = CullDuplicates(Points=solver.V, Tolerance=0.1, CullMode=3)  # -> flatten(Points), Indices, Valence

# ----
incurve_2 = PointInCurve(Point=cullpt.Points, Curve=rectangle.Rectangle)  # -> Relationship, Point
sift_2 = SiftPattern(List=pt_4, SiftPattern=incurve_2.Relationship)  # -> Output0, Output1, Output2
panel = Panel(sift_2.Output0)
pt_6 = Point(sift_2.Output2)
voronoi_2 = Voronoi(Points=pt_6, Radius=rectangle.Rectangle, BruteForceOverride=False)
trim = TrimWithRegions(Curve=voronoi_2, Regions=<geometry referenced from the Rhino model>)  # -> Inside, Outside
crv = Curve(trim.Inside)
